# Grasshopper definition jsonImport_Besucherversion.gh (Grasshopper 1.0.8)
# plug-ins: HAL for Grasshopper

# ---- group: input
boolean_toggle = BooleanToggle(True)
boolean_toggle_2 = BooleanToggle(False)

# ----
# originaldatei
file_path = FilePath("C:\Users\jkkru\Downloads\skatepark_20260719_1549.json")

# ----
# objekte in gruppen
# zusammengefasst
file_path_2 = FilePath("C:\Users\jkkru\Downloads\skatepark_20260723_0835.json")

panel = Panel(file_path_2)

# ----
# verarbeitet json-Datei aus
# der Besucherversion und erstellt die
# Geometrien
python_3_script = Python3Script(json_path=file_path_2, bake=boolean_toggle, clear=boolean_toggle_2)  # -> meshes, breps, layers, names, log
# ---------- python_3_script: Python ----------
# skatepark_import_mesh.py — GhPython / Rhino 8 Script-Komponente
# =============================================================================
# Liest die EXAKTE 3D-Geometrie aus dem JSON der Besucherversion (Feld "mesh"
# je Element) — für Objekte, die nicht parametrisch erstellt, sondern direkt
# in Rhino gezeichnet wurden. Das JSON bleibt gleichzeitig kompatibel zu
# skatepark_import_v2.py (parametrischer Rebuild über types/dims).
#
# ── INPUTS (im GH-Editor anlegen) ────────────────────────────────────────────
#   json_path │ str  │ Item │ Pfad zur .json aus der Besucherversion
#   bake      │ bool │ Item │ True = direkt ins aktive Rhino-Dokument baken
#                            (Layer inkl. Hierarchie + Farbe werden angelegt)
#   clear     │ bool │ Item │ True = vor dem Baken alle Objekte auf den
#                            Ziel-Layern löschen (optional, Standard False)
#
# ── OUTPUTS (im GH-Editor exakt so benennen) ─────────────────────────────────
#   meshes  │ list[Mesh] │ exakte Geometrie je Element (Rhino-Welt, cm)
#   breps   │ list[Brep] │ Mesh→Brep-Konvertierung — für bestehende
#                          Brep-basierte Bake-Nodes (skatepark_bake_grouped)
#   layers  │ list[str]  │ Layerpfad je Element (parallel zu meshes)
#   names   │ list[str]  │ Objektname je Element (parallel zu meshes)
#   log     │ str        │ Statusmeldung — unbedingt als Output anlegen!
#
# ── KOORDINATEN ──────────────────────────────────────────────────────────────
#   Die Vertices im JSON sind bereits fertige RHINO-Weltkoordinaten (Z-up, cm):
#   Rotation und Position sind von der Web-App eingerechnet, die Achsen-
#   konvertierung (rhino = web.x, -web.z, web.y) ebenfalls. Hier wird NICHTS
#   mehr transformiert — nur Mesh aufbauen.
# =============================================================================

import json
import Rhino
import Rhino.Geometry as rg

meshes = []
breps  = []
layers = []
names  = []
log    = ""
_errors = []

# ── JSON einlesen (IronPython-2-kompatibel: kein encoding-Parameter) ─────────
data = None
try:
    with open(json_path, 'r') as f:
        data = json.load(f)
except Exception as e:
    log = "FEHLER beim Oeffnen/Parsen: {}".format(e)

def _build_mesh(md):
    """mesh-Dict {vertices:[x,y,z,...], faces:[a,b,c,...]} -> rg.Mesh oder None."""
    verts = md.get('vertices') or []
    faces = md.get('faces') or []
    if len(verts) < 9 or len(faces) < 3:
        return None
    m = rg.Mesh()
    for i in range(0, len(verts) - 2, 3):
        m.Vertices.Add(float(verts[i]), float(verts[i + 1]), float(verts[i + 2]))
    vc = m.Vertices.Count
    for i in range(0, len(faces) - 2, 3):
        a, b, c = int(faces[i]), int(faces[i + 1]), int(faces[i + 2])
        if a < vc and b < vc and c < vc:
            m.Faces.AddFace(a, b, c)
    if m.Faces.Count == 0:
        return None
    m.Normals.ComputeNormals()
    m.Compact()
    return m

def _hex_color(hx):
    """'#rrggbb' -> (r, g, b) oder None."""
    try:
        hx = (hx or '').lstrip('#')
        return (int(hx[0:2], 16), int(hx[2:4], 16), int(hx[4:6], 16))
    except Exception:
        return None

# ── Elemente verarbeiten ─────────────────────────────────────────────────────
if data is not None:
    els = data.get('elements', [])
    for i, el in enumerate(els):
        try:
            md = el.get('mesh')
            if not md:
                _errors.append("Element {} ohne mesh-Feld (altes JSON?)".format(i))
                continue
            m = _build_mesh(md)
            if m is None:
                _errors.append("Element {}: Mesh nicht baubar".format(i))
                continue
            meshes.append(m)
            layers.append(str(el.get('layer', 'Import')))
            names.append(str(el.get('typeName', el.get('id', 'Objekt_{}'.format(i)))))
            # Brep-Konvertierung fuer Brep-basierte Bake-Nodes (kann bei sehr
            # grossen Meshes dauern — nur nutzen, wenn gebraucht)
            try:
                b = rg.Brep.CreateFromMesh(m, True)
                breps.append(b)
            except Exception:
                breps.append(None)
        except Exception as ex:
            _errors.append("Element {}: {}".format(i, ex))

    # ── Optional: direkt baken (Layer inkl. Hierarchie + Farbe) ──────────────
    if bake and meshes:
        doc = Rhino.RhinoDoc.ActiveDoc
        try:
            from System.Drawing import Color
        except Exception:
            Color = None

        def _ensure_layer_path(full_path, rgb):
            """Layerpfad 'A::B::C' anlegen (falls noetig), Index des Blatts zurueckgeben."""
            parts = [p.strip() for p in full_path.split('::') if p.strip()]
            if not parts:
                parts = ['Import']
            path_so_far = ''
            idx = -1
            for k, part in enumerate(parts):
                path_so_far = part if not path_so_far else path_so_far + '::' + part
                idx = doc.Layers.FindByFullPath(path_so_far, -1)
                if idx < 0:
                    lyr = Rhino.DocObjects.Layer()
                    lyr.Name = part
                    if k > 0:
                        parent_idx = doc.Layers.FindByFullPath(
                            '::'.join(parts[:k]), -1)
                        if parent_idx >= 0:
                            lyr.ParentLayerId = doc.Layers[parent_idx].Id
                    if Color is not None:
                        if k == len(parts) - 1 and rgb:
                            lyr.Color = Color.FromArgb(rgb[0], rgb[1], rgb[2])
                        else:
                            lyr.Color = Color.FromArgb(128, 130, 135)
                    idx = doc.Layers.Add(lyr)
            return idx

        # Layer-Indizes vorbereiten (+ optional leeren)
        layer_idx = {}
        for i, lp in enumerate(layers):
            if lp in layer_idx:
                continue
            rgb = _hex_color(els[i].get('color') if i < len(els) else None)
            layer_idx[lp] = _ensure_layer_path(lp, rgb)

        if clear:
            removed = 0
            for lp, li in layer_idx.items():
                if li < 0:
                    continue
                lyr = doc.Layers[li]
                for o in doc.Objects.FindByLayer(lyr) or []:
                    doc.Objects.Delete(o, True)
                    removed += 1
            _errors.append("{} alte Objekte geloescht".format(removed)) if removed else None

        baked = 0
        for i, m in enumerate(meshes):
            attr = Rhino.DocObjects.ObjectAttributes()
            li = layer_idx.get(layers[i], -1)
            if li >= 0:
                attr.LayerIndex = li
            attr.Name = names[i]
            gid = doc.Objects.AddMesh(m, attr)
            if gid != gid.Empty:
                baked += 1
        doc.Views.Redraw()
        log = "GEBAKT: {}/{} Meshes auf {} Layer".format(baked, len(meshes), len(layer_idx))
    else:
        src = data.get('source', '?')
        log = "OK | {} Meshes aus '{}' | bake=False (nur GH-Geometrie)".format(len(meshes), src)

if _errors:
    log += " | HINWEISE: " + " | ".join(_errors[:6])
# ---------- end python_3_script ----------

# ----
# sortiert die Geometrien zu den dazugehörigen Layern,
# für die Weiterarbeit mit den verschiedenen Layern
python_3_script_2 = Python3Script(breps=python_3_script.breps, layers=python_3_script.layers)  # -> geo_tree, unique_layers, counts, log; inputs breps: list, layers: list of String
# ---------- python_3_script_2: Python ----------
# skatepark_split_layers.py — GhPython / Rhino 8 Script-Komponente
# =============================================================================
# Teilt eine flache Brep-Liste anhand der parallelen Layer-Liste in einen
# DataTree auf: ein Branch pro Layer. Danach kann in Grasshopper pro
# Layer-Gruppe weitergearbeitet werden.
#
# Der Tree wird über ghpythonlib.treehelpers erzeugt — das funktioniert
# identisch im alten GhPython (IronPython 2) UND im neuen Rhino-8-Script-
# Editor (Python 3). Direktes DataTree[object]() macht dort Probleme
# (orange Leitung / leerer Output).
#
# ── INPUTS (im GH-Editor exakt so benennen!) ─────────────────────────────────
#   breps  │ List Access │ Type hint: No Type Hint (nimmt Breps UND Meshes)
#   layers │ List Access │ Type hint: str │ Layername je Brep (parallel!)
#
#   → z. B. direkt die Ausgänge geometry/layers der Build-Node oder
#     meshes/layers bzw. breps/layers der skatepark_import_mesh-Node.
#
# ── OUTPUTS (im GH-Editor anlegen) ───────────────────────────────────────────
#   geo_tree      │ DataTree │ Branch {0;0} = alle Breps des 1. Layers usw.
#                             (Reihenfolge = erstes Auftreten, stabil)
#   unique_layers │ list[str]│ Layername je Branch, index-gleich zu geo_tree
#   counts        │ list[int]│ Anzahl Geometrien je Branch (Kontrolle)
#   log           │ str      │ Statusmeldung
#
# ── WEITERARBEITEN MIT EINZELNEN LAYERN ──────────────────────────────────────
#   a) Explode Tree ("Bang!") an geo_tree → ein Ausgang pro Branch.
#   b) Gezielt einen Layer holen:
#        Member Index  (Set = unique_layers, Member = "QTRS")  → Index i
#        Tree Branch   (Tree = geo_tree, Path = {0;i})         → Brep-Liste
#   c) geo_tree direkt weiterleiten — GH-Komponenten arbeiten automatisch
#      branch-weise, jede Operation läuft getrennt pro Layer.
# =============================================================================

import ghpythonlib.treehelpers as th

unique_layers = []
counts = []
log = ""

_b = list(breps) if breps else []
_l = [str(x) for x in layers] if layers else []

if not _b:
    log = "Keine Breps am Eingang."
elif len(_b) != len(_l):
    n = min(len(_b), len(_l))
    log = "WARNUNG: {} Breps, aber {} Layer — nur die ersten {} Paare verwendet. ".format(
        len(_b), len(_l), n)
    _b, _l = _b[:n], _l[:n]

# Verschachtelte Listen: eine innere Liste pro Layer
nested = []
for brep, lay in zip(_b, _l):
    if brep is None:
        continue
    if lay not in unique_layers:
        unique_layers.append(lay)
        nested.append([])
    nested[unique_layers.index(lay)].append(brep)

geo_tree = th.list_to_tree(nested) if nested else None
counts = [len(lst) for lst in nested]

log += "OK | {} Geometrien in {} Layer-Branches: {}".format(
    sum(counts), len(unique_layers),
    ", ".join("{}({})".format(l, c) for l, c in zip(unique_layers, counts)))
# ---------- end python_3_script_2 ----------
panel_2 = Panel(python_3_script_2.unique_layers)
panel_3 = Panel(python_3_script_2.counts)
panel_4 = Panel(python_3_script_2.log)
explode_tree = ExplodeTree(Data=python_3_script_2.geo_tree)  # -> Branch0, Branch1, Branch2, Branch3, Branch4, Branch5

# ---- group: output
brep = Brep(explode_tree.Branch0)
brep_2 = Brep(explode_tree.Branch1)
brep_3 = Brep(explode_tree.Branch2)
brep_4 = Brep(explode_tree.Branch3)
brep_5 = Brep(explode_tree.Branch4)
brep_6 = Brep(explode_tree.Branch5)

# ----
# Walls
colour_swatch = ColourSwatch(SwatchColor=RGB(79, 78, 77))
custom_preview = CustomPreview(Geometry=brep_4, Material=colour_swatch)

# ----
# Mobile Ramps
colour_swatch_2 = ColourSwatch(SwatchColor=RGB(19, 158, 31))
custom_preview_2 = CustomPreview(Geometry=brep, Material=colour_swatch_2)

# ----
# Flats
colour_swatch_3 = ColourSwatch(SwatchColor=RGB(130, 129, 124))
custom_preview_3 = CustomPreview(Geometry=brep_5, Material=colour_swatch_3)

# ----
# QTRS
colour_swatch_4 = ColourSwatch(SwatchColor=RGB(209, 140, 50))
custom_preview_4 = CustomPreview(Geometry=brep_6, Material=colour_swatch_4)

# ----
# BNKS
colour_swatch_5 = ColourSwatch(SwatchColor=RGB(114, 158, 194))
custom_preview_5 = CustomPreview(Geometry=brep_2, Material=colour_swatch_5)

# ----
# Rails
colour_swatch_6 = ColourSwatch(SwatchColor=RGB(176, 176, 176))
custom_preview_6 = CustomPreview(Geometry=brep_3, Material=colour_swatch_6)

session_settings = SessionSettings()
